# Grasshopper definition 150429_StepByStep.gh (Grasshopper 0.9.76)
# plug-ins: Python Interpreter, Kangaroo Components, Kangaroo2 Components

# ---- group: Input Mesh
# How to make your own custom solver component
mesh = Mesh(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)

# ---- group: Get Vertices and Edges
nv = NakedVertices(Mesh=mesh)  # -> ClothedIndex, NakedIndex, ClothedPts, NakedPts
medges = MeshEdges(Mesh=mesh)  # -> NakedEdges, InteriorEdges, NonManifoldEdges

# ---- group: Make Goals
anchor = Anchor(Point=nv.NakedPts, Strength=1000)
length_line = LengthLine(Line=[medges.InteriorEdges, medges.NakedEdges], Length="0", Strength=10)

# ---- group: Solve the Goals using a Custom Iteration Script
reset = Button(ExpressionPressed="true")
step = Button(ExpressionPressed="true")
ksolver = PythonScript(Goals=[anchor, length_line], Reset=reset, Step=step)  # -> A, B; inputs Goals: list, Reset: Boolean, Step: Boolean
# ---------- ksolver: Python ----------
"""
Solve Kangaroo2 goals using a custom iteration script.
Based on Daniel Pikers StepByStep.gh definition.
-
Author: Anders Holden Deleuran
Github: github.com/AndersDeleuran/KangarooGHPython
Updated: 150429
"""

import clr
clr.AddReferenceToFile("KangarooSolver.dll")
import KangarooSolver as ks
from System.Collections.Generic import List

# Reset state
if Reset or "counter" not in globals():
    
    # Make physical system and goals list (using .NET type list)
    ps = ks.PhysicalSystem()
    goalList = List[ks.IGoal]()
    
    # Add goals to system and goals list
    for g in Goals:
        ps.AssignPIndex(g,0.01)
        goalList.Add(g)
        
    # Make static counter variable
    counter = 0
        
# Run state
else:
    if Step:
        ps.Step(goalList,True, 1)
        counter += 1
        
# Output to GH
A = ps.GetOutput(goalList)
B = counter
# ---------- end ksolver ----------
panel = Panel(ksolver.B)
