# Grasshopper definition 150501_CustomSolverLive_Elastica.gh (Grasshopper 0.9.76)
# plug-ins: Python Interpreter, Kangaroo2 Components

polylinewithdifferentsegmentlengths = Curve(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)
# How to make your own custom solver component which runs "live".
polylinewithsamesegmentlengths = Curve(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)

# ---- group: Bending
explode = Explode(Curve=polylinewithdifferentsegmentlengths, Recursive=True)  # -> Segments, Vertices
cull_i = CullIndex(List=explode.Segments, Indices=-1, Wrap=True)
shift = ShiftList(List=explode.Segments, Shift=1, Wrap=False)
angle = Angle(LineA=cull_i, LineB=shift, RestAngle=0, Strength=Slider(11.68, range=0..20))

# ---- group: Springs
explode_2 = Explode(Curve=polylinewithdifferentsegmentlengths, Recursive=True)  # -> Segments, Vertices
length_line = LengthLine(Line=explode_2.Segments, Strength=Slider(7.12, range=0..10))

# ---- group: Anchors
end = EndPoints(Curve=polylinewithdifferentsegmentlengths)  # -> Start, End
anchor = Anchor(Point=[end.Start, end.End], Strength=1000)

# ----
show = Show(G=polylinewithdifferentsegmentlengths)

# ---- group: Solver
pause = BooleanToggle(False)
reset = BooleanToggle(True)
goals = Data(flatten([show, anchor, length_line, angle]))
ksolver = PythonScript(Goals=goals, Reset=reset, Pause=pause, Iterations=Slider(5, range=0..100))  # -> GoalsOutput, Points, Counter, VSum; inputs Goals: list, Reset: Boolean, Pause: Boolean, Iterations: Int32
# ---------- ksolver: Python ----------
"""
Solve Kangaroo2 goals using a custom iteration script which runs "live".
Based on Daniel Pikers StepByStep.gh definition.
-
Author: Anders Holden Deleuran
Github: github.com/AndersDeleuran/KangarooGHPython
Updated: 150501
"""

import clr
clr.AddReferenceToFile("KangarooSolver.dll")
import KangarooSolver as ks
from System.Collections.Generic import List
import Grasshopper as gh

def ghComponentTimer(ghenv,pause,interval):
    
    """ Update the component at the interval like using a GH timer """
    
    # Ensure interval is larger than zero
    if interval <= 0:
        interval = 1
        
    # Get the Grasshopper document and component that owns this script
    ghComp = ghenv.Component
    ghDoc = ghComp.OnPingDocument()
    
    # Define the callback function
    def callBack(ghDoc):
        ghComp.ExpireSolution(False)
        
    # Update the solution
    if not pause:
        ghDoc.ScheduleSolution(interval,gh.Kernel.GH_Document.GH_ScheduleDelegate(callBack))


# Reset State
if Reset or "counter" not in globals():
    
    # Make physical system and goals list
    ps = ks.PhysicalSystem()
    goalList = List[ks.IGoal]()
    
    # Add goals to system and goals list
    for g in Goals:
        ps.AssignPIndex(g,0.01)
        goalList.Add(g)
        
    # Make static counter variable
    counter = 0
    
# Run State
else:
    
    # Solve n times at each GH iteration
    for i in range(Iterations):
        
        # Step the system
        ps.Step(goalList,True,1)
        
        # Get the velocity sum and increment the counter
        VSum = ps.GetvSum()
        counter += 1
        
        # Update the GH component
        ghComponentTimer(ghenv,Pause,5)
        
# Output the GH
GoalsOutput = ps.GetOutput(goalList)
Points = "foo"
Counter = counter
# ---------- end ksolver ----------
panel = Panel([ksolver.Counter, ksolver.VSum])

# ----
panel_2 = Panel(ksolver.GoalsOutput)
