# Grasshopper definition TangentIncircles.gh (Grasshopper 0.9.76)
# plug-ins: Python Interpreter, Kangaroo Components, Kangaroo2 Components

# ---- group: Make Input Geometry
pop2d = Populate2D(Region={Plane=PlaneXY(0, 0, 0), Size=Domain2(u=0..20, v=0..10)}, Count=100, Seed=1)
# How to make goals and pass along to solver.
del = DelaunayMesh(Points=pop2d, Plane=PlaneXY(0, 0, 0))

# ---- group: TangentIncircles Goals
hingepoints = HingePoints(Mesh=del)  # -> _1, _2, _3, _4
ti = PythonScript(A=hingepoints._1, B=hingepoints._2, C=hingepoints._3, D=hingepoints._4)  # -> TI, a; inputs A: list, B: list, C: list, D: list
# ---------- ti: Python ----------
"""
How to make and output Kangaroo2 goals.
-
Author: Anders Holden Deleuran
Github: github.com/AndersDeleuran/KangarooGHPython
Updated: 150429
"""

# Add reference to the Kangaroo dll
import clr
clr.AddReferenceToFile("KangarooSolver.dll")

# Import the Kangaroo namespace using an alias
import KangarooSolver as ks

# Make empty output list
TI = []

# Iterate inputs and make goals
for i in range(len(A)):
    g = ks.Goals.TangentIncircles(A[i],C[i],B[i],D[i],10.0)
    
    # Add to output list
    TI.append(g)
# ---------- end ti ----------

# ----
reset = Button()

# ---- group: Show (Still figuring this one out)
S = PythonScript(G=del)  # -> GL; inputs G: list
# ---------- S: Python ----------
"""
How to make and output Kangaroo2 goals.
-
Author: Anders Holden Deleuran
Github: github.com/AndersDeleuran/KangarooGHPython
Updated: 150501
"""

import Rhino as rc
import clr
clr.AddReferenceToFile("KangarooSolver.dll")
import KangarooSolver as ks
import Grasshopper.Kernel.Types as gkt

# Make empty output list
GL = []

# Iterate inputs and make locator goals
for geo in G:
    
    if isinstance(geo,rc.Geometry.Mesh):
        gGh = gkt.GH_Mesh(geo)
        
    elif isinstance(geo,rc.Geometry.Point3d):
        gGh = gkt.GH_Point(geo)
        
    gow = gkt.GH_ObjectWrapper(gGh)
    gl = ks.Goals.Locator(gow) # Does this need to know about Grasshopper types?
    GL.append(gl)
# ---------- end S ----------

# ---- group: OnPlane Goal
op = PythonScript(Pts=pop2d)  # -> P; inputs Pts: list
# ---------- op: Python ----------
"""
How to make and output Kangaroo2 goals.
-
Author: Anders Holden Deleuran
Github: github.com/AndersDeleuran/KangarooGHPython
Updated: 150429
"""

import clr
clr.AddReferenceToFile("KangarooSolver.dll")
import KangarooSolver as ks
import Rhino as rc
from System.Collections.Generic import List

# Convert Python points list to .NET type list
ptsList = List[rc.Geometry.Point3d](Pts)

# Make the OnPlane goal and output to GH
P = ks.Goals.OnPlane(ptsList,rc.Geometry.Plane.WorldXY,1.0)
# ---------- end op ----------

# ----
solver = Solver(
    GoalObjects=[S, ti.TI, op],
    Reset=reset,
    Restart=False,
    Parallel=True,
    Threshold=1e-15,
    Tolerance=0.01,
    AddCurrent=False,
    On=True)  # -> V, O
item = ListItem(List=solver.O, Index=0, Wrap=True)
faceb = FaceBoundaries(Mesh=item)
explode = Explode(Curve=faceb, Recursive=True)  # -> Segments, Vertices
item_2 = ListItem(List=explode.Vertices, Index=0, Wrap=True)  # -> Item, Item1, Item2

# ---- group: circlepacking
tangentcircles = TangentCircles(mesh=item)

# ---- group: incircles
incircle = InCircle(CornerA=item_2.Item, CornerB=item_2.Item1, CornerC=item_2.Item2)  # -> Circle, Plane, Radius

# ==== cluster TangentCircles: A compact circle packing from a flat mesh
mesh = ClusterInput()
mesh_2 = Mesh(mesh)
nv = NakedVertices(Mesh=mesh_2)  # -> ClothedIndex, NakedIndex, ClothedPts, NakedPts
vn = VertexNeighbours(Mesh=mesh_2, VertexNumber=nv.ClothedIndex)  # -> graft(Vertex), Neighbours, Normal
item = ListItem(List=vn.Neighbours, Index=0, Wrap=True)  # -> Item, Item1
dist = Distance(PointA=item.Item, PointB=item.Item1)
dist_2 = Distance(PointA=vn.Vertex, PointB=[item.Item, item.Item1])
ma = MassAddition(Input=[dist_2, dist])  # -> Result, PartialResults
multiplication = Multiplication(A=ma.Result, B=0.5)
pl = PlaneNormal(Origin=vn.Vertex, ZAxis=graft(vn.Normal))
subtraction = Subtraction(A=multiplication, B=dist)
cir = Circle(Plane=pl, Radius=subtraction)  # -> flatten(Circle)
C = ClusterOutput(cir)
