# Grasshopper definition TensileRelaxScript.gh (Grasshopper 0.9.76)
# plug-ins: Python Interpreter

# How to make your own custom solver component which runs zombie-like.
mesh = Mesh(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)
customiteration = CSharpScript(M=mesh, Reference="C:\Users\adel\AppData\Roaming\Grasshopper\Libraries\KangarooSolver.dll")  # -> out, A, B; inputs M: Mesh
# ---------- customiteration: C# ----------
    //initialize the solver
    var PS = new KangarooSolver.PhysicalSystem();
    var Goals = new List<IGoal>();

    //get the Mesh points and boundary status
    Point3d[] Pts = M.Vertices.ToPoint3dArray();
    bool[] Naked = M.GetNakedEdgePointStatus();

    for(int i = 0; i < M.Vertices.Count;i++)
    {
      PS.AddParticle(Pts[i], 1); //add a particle for every mesh vertex
      if(Naked[i])
      {Goals.Add(new KangarooSolver.Goals.Anchor(i, Pts[i], 10000));}// fix the boundaries strongly in place
    }

    for(int i = 0; i < M.TopologyEdges.Count;i++)
    {
      var Ends = M.TopologyEdges.GetTopologyVertices(i);
      int Start = M.TopologyVertices.MeshVertexIndices(Ends.I)[0];
      int End = M.TopologyVertices.MeshVertexIndices(Ends.J)[0];
      Goals.Add(new KangarooSolver.Goals.Spring(Start, End, 0, 1)); //for each edge, a spring with rest length 0, and strength 1
    }

    int counter = 0;
    double threshold = 1e-6;
    do
    {
      //Step forward, using these goals, with multi-threading on, and stopping if the threshold is reached
      PS.Step(Goals, true, threshold);
      counter++;
    }while(PS.GetvSum() > threshold && counter < 100);
    //GetvSum returns the current kinetic energy
    //always include a counter to prevent it getting stuck forever in case it cannot reach the given threshold

    //replace the mesh vertices with the relaxed ones
    M.Vertices.Clear();
    M.Vertices.AddVertices(PS.GetPositions());

    //Output the mesh, and how many iterations it took to converge
    A = M;
    B = counter;
# ---------- end customiteration ----------
python = PythonScript(M=mesh)  # -> out, A, B; inputs M: Mesh
# ---------- python: Python ----------
"""
Solve Kangaroo2 goals using a custom iteration script ala Zombie mode.
Based on Daniel Pikers TensileRelaxScript.gh definition.
-
This is quite a bit slower than the C# version, will have to profile deeper.
I suspect it might simply be the sum of all the KangarooSolver calls which 
become more apparent when solved zombie-style.
-
Author: Anders Holden Deleuran
Github: github.com/AndersDeleuran/KangarooGHPython
Updated: 150502
"""

import clr
clr.AddReferenceToFile("KangarooSolver.dll")
import KangarooSolver as ks
from System.Collections.Generic import List

# Make solver system and goals list
ps = ks.PhysicalSystem()
goals = List[ks.IGoal]()

# Get the mesh vertices and boundary status
pts = M.Vertices.ToPoint3dArray()
naked = M.GetNakedEdgePointStatus()

# Add vertices as particles and naked vertices as anchors
for i in range(M.Vertices.Count):
    ps.AddParticle(pts[i],1)
    if naked[i]:
        goals.Add(ks.Goals.Anchor(i,pts[i],10000))

# Add edges as springs
for i in range(M.TopologyEdges.Count):
    ends = M.TopologyEdges.GetTopologyVertices(i)
    start = M.TopologyVertices.MeshVertexIndices(ends.I)[0]
    end = M.TopologyVertices.MeshVertexIndices(ends.J)[0]
    goals.Add(ks.Goals.Spring(start,end,0,1))

# System state variables
counter = 0
threshold = 1e-6

# Solve zombie style i.e. max N iterations, break when system kinetic energy drops below threshold
while counter < 100:
    ps.Step(goals,True,threshold)
    counter += 1
    if ps.GetvSum() < threshold:
        break

# Replace the mesh vertices with the relaxed ones
M.Vertices.Clear()
M.Vertices.AddVertices(ps.GetPositions())

# Output the mesh, and how many iterations it took to converge
A = M
B = counter
# ---------- end python ----------
panel = Panel(customiteration.B)
panel_2 = Panel(python.B)
move = Move(Geometry=python.A, Motion=Vector(0, -64.31287156, 0))  # -> Geometry, Transform
